# Grasshopper definition ChristmasTree_hops.gh (Grasshopper 1.0.7)

tree_radius = GetNumber(Slider(1.6, range=0..2), AtLeast=1, AtMost=1, Maximum=1.797693135e+308, Minimum=-1.797693135e+308, TreeAccess=False)
tree_height = GetInteger(Slider(5, range=1..5), AtLeast=1, AtMost=1, Maximum=2147483647, Minimum=-2147483648, TreeAccess=False)
cone = Cone(Base=PlaneXY(0, 0, 0), Radius=tree_radius, Length=tree_height)  # -> Cone, Tip
preview = CustomPreview(Geometry=cone.Cone, Material=ColourSwatch(SwatchColor=RGB(91, 146, 110)))

pt = Point(Point(0, 0, 0))

ornament_count = GetInteger(Slider(30, range=0..100), AtLeast=1, AtMost=1, Maximum=2147483647, Minimum=-2147483648, TreeAccess=False)
ornament_radius = GetNumber(Slider(0.2, range=-0.5..0.5), AtLeast=1, AtMost=1, Maximum=1.797693135e+308, Minimum=-1.797693135e+308, TreeAccess=False)

popgeo = PopulateGeometry(Geometry=cone.Cone, Count=ornament_count, Seed=1)
sph = Sphere(Base=pt, Radius=ornament_radius)
orient = Orient(Geometry=sph, Source=pt, Target=popgeo)  # -> Geometry, Transform
preview_2 = CustomPreview(Geometry=orient.Geometry, Material=ColourSwatch(SwatchColor=RGB(237, 19, 110)))

geo = Geometry([orient.Geometry, cone.Cone])
context_bake = ContextBake(Geometry=geo)
